# Grasshopper definition GH-thermal-simulation-test.gh (Grasshopper 1.0.7)
# plug-ins: ThermalSimulation, Kangaroo2 Components

digit_scroller = DigitScroller(Scroller_Digits=12, Scroller_Prefix="B", Scroller_Radix=9, Scroller_Value=400)
pipeline = GeometryPipeline(
    GroupByLayer=False,
    GroupByType=False,
    IncludeHidden=True,
    IncludeLocked=True,
    LayerFilter="*",
    NameFilter="*",
    SublayerFiltering=True,
    TypeFilter=1073741881)
area = Area(Geometry=pipeline)  # -> Area, Centroid
viewer = ParamViewer(pipeline)
division = Division(A=area.Area, B=digit_scroller)
triremesh = TriRemesh(Geometry=pipeline, Sharp=True, Length=division, Iterations=25)  # -> Triangulation, Dual, Creases
thermalsim = ThermalSimulation(Mesh=pipeline, Mesh_2=triremesh.Triangulation, Assign=False)
preview = CustomPreview(
    Geometry=thermalsim,
    Material={diffuse=RGB(221, 160, 221), emission=RGB(66, 48, 66), shine=0.5, specular=RGB(255, 255, 255), transparency=0})
