# Grasshopper definition GH-thermal-simulation-test0.gh (Grasshopper 1.0.7)
# plug-ins: ThermalSimulation

pipeline = GeometryPipeline(
    GroupByLayer=False,
    GroupByType=False,
    IncludeHidden=True,
    IncludeLocked=True,
    LayerFilter="S*",
    NameFilter="*",
    SublayerFiltering=True,
    TypeFilter=1073741848)

animate = Slider(1, range=0..1)
animation_steps_per_hour = Slider(1, range=1..10)
simulation_steps_per_hour = Slider(1, range=1..10)
simulation_days = Slider(1, range=0..32)

subdivision_length = DigitScroller(Scroller_Digits=12, Scroller_Prefix="Subdivision Length", Scroller_Radix=6, Scroller_Value=1)
min_kelvin = DigitScroller(Scroller_Digits=12, Scroller_Prefix="Min. Kelvin", Scroller_Radix=6, Scroller_Value=0)
max_kelvin = DigitScroller(Scroller_Digits=12, Scroller_Prefix="Max. Kelvin", Scroller_Radix=6, Scroller_Value=0.0002)

# ---- group: Manual Control
reset = Button()
simulate = Button()
reload_geometry = Button()

# ---- group: Start Time
number_slider = Slider(9, range=0..23)
number_slider_2 = Slider(12, range=1..31)
number_slider_3 = Slider(7, range=1..12)

# ----
hoy_calc = HoyCalc(
    month=number_slider_3,
    day=number_slider_2,
    hour=number_slider,
    A_2=animate,
    A=simulation_days,
    A_3=animate,
    B_2=animation_steps_per_hour,
    B=simulation_steps_per_hour)  # -> R_2, R_3, R

weather = Weather()  # -> location, direct_normal_rad, diffuse_horizontal_rad
mesh = Mesh(geometry=pipeline, length=subdivision_length)
sun_arrow = SunArrow(location=weather.location, hoys=hoy_calc.R_2)
date_tag = DateTag(hoy=hoy_calc.R_2)

hoy = LBCalculateHOY(month=number_slider_3, day=number_slider_2, hour=number_slider)  # -> flatten(hoy), flatten(doy), flatten(date); plug-in component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

sky_anim = SkyAnim(
    location=weather.location,
    direct_rad=weather.direct_normal_rad,
    diffuse_rad=weather.diffuse_horizontal_rad,
    hoys=hoy_calc.R_2)  # -> mesh, sky_mtx, mesh_values
thermalsim = ThermalSimulation(
    Geometry=pipeline,
    Meshes=mesh,
    port=False,
    SkyMesh=sky_anim.mesh,
    SkyValues=sky_anim.mesh_values,
    SkyValuesTimespan=1,
    port_2=False,
    ReloadGeometry=reload_geometry,
    ReloadSkyValues=False,
    port_3=False,
    StepSize=hoy_calc.R,
    StepCount=simulation_steps_per_hour,
    Simulate=simulate,
    ResetSimulation=reset,
    SimulationStep=hoy_calc.R_3,
    EnableSteadyState=False,
    ValueType=1)  # -> Mesh, Kelvin, TimeHours
bar_graph = BarGraph(thermalsim.Kelvin, BarColor=RGB(255, 0, 90))
bnd = Bounds(Numbers=thermalsim.Kelvin)
panel = Panel(thermalsim.TimeHours)
panel_2 = Panel(bnd)

skymatrix = LBCumulativeSkyMatrix(
    location=weather.location,
    direct_rad=weather.direct_normal_rad,
    diffuse_rad=weather.diffuse_horizontal_rad,
    hoys=hoy.hoy,
    high_density=1)  # -> report, sky_mtx; plug-in component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
skymatrix_2 = LBCumulativeSkyMatrix(
    location=weather.location,
    direct_rad=weather.direct_normal_rad,
    diffuse_rad=weather.diffuse_horizontal_rad,
    hoys=hoy_calc.R_2,
    high_density=1)  # -> report, sky_mtx; plug-in component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
mjoin = MeshJoin(Meshes=mesh)
min_kelvin_2 = DigitScroller(Scroller_Digits=12, Scroller_Prefix="Min. Kelvin", Scroller_Radix=6, Scroller_Value=0.2)
max_kelvin_2 = DigitScroller(Scroller_Digits=12, Scroller_Prefix="Max. Kelvin", Scroller_Radix=6, Scroller_Value=1.4)
incidentradiation = LBIncidentRadiation(sky_mtx=skymatrix.sky_mtx, geometry=flatten(mjoin), grid_size=1, cpu_count=12, run=Toggle(True))  # -> report, points, results, total, mesh, legend, title, int_mtx; plug-in component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
rtrad = LBRealTimeIncidentRadiation(int_mtx=incidentradiation.int_mtx, sky_mtx=skymatrix_2.sky_mtx)  # -> results; plug-in component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
legendpar = LBLegendParameters(min=min_kelvin_2, max=max_kelvin_2)  # -> leg_par; plug-in component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
visualization = Visualization(values=thermalsim.Kelvin, M=thermalsim.Mesh, min=min_kelvin, max=max_kelvin)
heatmap = LBSpatialHeatmap(values=rtrad, mesh=incidentradiation.mesh, legend_par=legendpar, legend_title="kWh/m2")  # -> mesh, legend, title, colors, legend_par; plug-in component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

# ==== cluster Mesh
geometry = ClusterInput()
length = ClusterInput()
triremesh = TriRemesh(Geometry=geometry, Length=length, Iterations=25)  # -> Triangulation, Dual, Creases
unim = UnifyMesh(Mesh=triremesh.Triangulation)  # -> Result, Count
R = ClusterOutput(unim.Result)

# ==== cluster Weather
panel = Panel("https://energyplus-weather.s3.amazonaws.com/asia_wmo_region_2/IRN/IRN_Shiraz.408480_ITMY/IRN_Shiraz.408480_ITMY.zip")
downloadepw = LBDownloadWeather(weather_URL=panel)  # -> epw_file, stat_file, ddy_file; plug-in component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
importepw = LBImportEPW(epw_file=downloadepw.epw_file)  # -> location, dry_bulb_temperature, dew_point_temperature, relative_humidity, wind_speed, wind_direction, direct_normal_rad, diffuse_horizontal_rad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; plug-in component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
location = ClusterOutput(importepw.location)
direct_normal_rad = ClusterOutput(importepw.direct_normal_rad)
diffuse_horizontal_rad = ClusterOutput(importepw.diffuse_horizontal_rad)

# ==== cluster SkyAnim
location = ClusterInput()
direct_rad = ClusterInput()
diffuse_rad = ClusterInput()
hoys = ClusterInput()
skymatrix = LBCumulativeSkyMatrix(location=location, direct_rad=direct_rad, diffuse_rad=diffuse_rad, hoys=hoys, high_density=1)  # -> report, sky_mtx; plug-in component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
sky_mtx = ClusterOutput(skymatrix.sky_mtx)
skydome_scale = Slider(0.005, range=0..1)
skydome = LBSkyDome(sky_mtx=skymatrix.sky_mtx, scale=skydome_scale)  # -> report, mesh, compass, legend, title, patch_vecs, patch_values, mesh_values; plug-in component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
mesh = ClusterOutput(skydome.mesh)
mesh_values = ClusterOutput(skydome.mesh_values)

# ==== cluster SunArrow
scale = Slider(0.0005, range=0..1)
location = ClusterInput()
hoys = ClusterInput()
scale_2 = Slider(-31.497143, range=-1000..-1)
sunpath = LBSunPath(location=location, hoys=hoys, scale=scale)  # -> report, vectors, altitudes, azimuths, hoys, sun_pts, analemma, daily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; plug-in component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
multiplication = Multiplication(A=sunpath.vectors, B=scale_2)
vdis = VectorDisplay(Anchor=Point(1, 1, 0), Vector=multiplication)

# ==== cluster DateTag
hoy = ClusterInput()
scale = Slider(2.6, range=0..10)
datetime = LBHOYToDateTime(hoy=hoy)  # -> month, day, hour, minute, date; plug-in component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
tag = TextTag3D(Location=PlaneXY(-32, -21, 0), Text=datetime.date, Size=scale, Colour=RGB(0, 0, 0), Justification=7)

# ==== cluster Visualization
M = ClusterInput()
mjoin = MeshJoin(Meshes=M)
min = ClusterInput()
max = ClusterInput()
legendpar = LBLegendParameters(min=min, max=max, continuous_leg=1, num_decimals=1)  # -> leg_par; plug-in component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
values = ClusterInput()
heatmap = LBSpatialHeatmap(values=values, mesh=mjoin, legend_par=legendpar, legend_title="°K")  # -> mesh, legend, title, colors, legend_par; plug-in component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

# ==== cluster HoyCalc
month = ClusterInput()
day = ClusterInput()
hour = ClusterInput()
A = ClusterInput()
B = ClusterInput()
hoy = LBCalculateHOY(month=month, day=day, hour=hour)  # -> flatten(hoy), flatten(doy), flatten(date); plug-in component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
multiplication = Multiplication(A=A, B=24)
division = Division(A=1, B=B)
B_2 = ClusterInput()
A_2 = ClusterInput()
R = ClusterOutput(division)
A_3 = ClusterInput()
multiplication_2 = Multiplication(A=multiplication, B=B_2)
multiplication_3 = Multiplication(A=A_2, B=multiplication)
multiplication_4 = Multiplication(A=A_3, B=multiplication_2)
integer_division = IntegerDivision(A=multiplication_3, B=1)
addition = Addition(A=hoy.hoy, B=integer_division)
integer_division_2 = IntegerDivision(A=multiplication_4, B=1)
R_2 = ClusterOutput(addition)
R_3 = ClusterOutput(integer_division_2)
